# Grasshopper definition ProteinGenerator.gh (Grasshopper 1.0.7)
# Copyright: Use it.  Mod it.  Share it. Just please give credit and keep this party going.
# Copyright: Use it.  Mod it.  Share it. Just please give credit and kepp this party going.
# plug-ins: Human UI, FalseStartToggle

circle = Circle(Plane=PlaneXY(0, 0, 0), Radius=1)
shape_in_brep = ShapeInBrep()
create_shapes = CreateShapes(Shapes=circle, StrokeColor=RGB(0, 0, 0), Scale=1, ClickMode=3)
panel = Panel(create_shapes)

# ----
# Visualisation Parameters
create_color_picker = CreateColorPicker()
merge = Merge(Data1=flatten(create_color_picker))
create_expander = CreateExpander(UIElements=merge, Header="VISUALISATION PARAMETERS", Open=True)

false_start_toggle = FalseStartToggle(False)

# ----
# Interpolation Parameters
create_color_picker_2 = CreateColorPicker()
merge_2 = Merge(Data1=flatten(create_color_picker_2))
create_expander_2 = CreateExpander(UIElements=merge_2, Header="INTERPOLATION PARAMETERS", Open=false_start_toggle)

# ----
# Try creating different kinds of charts to see how they display data.
chart_type = ValueList({"Pie Chart": 0, "Horizontal Bar Chart": 1, "Vertical Bar Chart": 2, "Doughnut Chart": 3, "Gauge Chart": 4}, selected="Pie Chart")
pan = Panel("""342
431
554
123
34""")
pan_2 = Panel("""GLN
HIS
THR
VAL
MET""")
create_chart = CreateChart(Data=pan, Names=pan_2, Title="Protein", SubTitle="Heavy water", ChartType=chart_type)

# ----
# Use this slider to control the size
# of the Amino Acid Spheres in the visualisation
size_of_main_chain_aa = Slider(0.5, range=0..1)
listtotree = GhPythonScript()  # -> output; inputs Lists: list
# ---------- listtotree: Python ----------
__author__ = "Flora"
__version__ = "2021.01.18"

import rhinoscriptsyntax as rs



#Created By piac
#from https://gist.github.com/piac/ef91ac83cb5ee92a1294
def list_to_tree(input, none_and_holes=True, source=[0]):
    """Transforms nestings of lists or tuples to a Grasshopper DataTree"""
    from Grasshopper import DataTree as Tree
    from Grasshopper.Kernel.Data import GH_Path as Path
    from System import Array
    def proc(input,tree,track):
        path = Path(Array[int](track))
        if len(input) == 0 and none_and_holes: tree.EnsurePath(path); return
        for i,item in enumerate(input):
            if hasattr(item, '__iter__'): #if list or tuple
                track.append(i); proc(item,tree,track); track.pop()
            else:
                if none_and_holes: tree.Insert(item,path,i)
                elif item is not None: tree.Add(item,path)
    if input is not None: t=Tree[object]();proc(input,t,source[:]);return t

output=list_to_tree(Lists)
# ---------- end listtotree ----------
create_stack = CreateStack(Horizontal=True)
multiplylist = GhPythonScript(tree=listtotree)  # -> tree, multipliedList; inputs tree: tree
# ---------- multiplylist: Python ----------
__author__ = "Flora"
__version__ = "2021.01.18"

import rhinoscriptsyntax as rs

for i in range(tree.BranchCount):
    #subList=[]
    print(i)
    #for ii in tree.Branch(i):
    #    subList.append(list[i])
    #multipliedList.append(subList)

#multipliedList=list_to_tree(multipliedList)
# ---------- end multiplylist ----------

# ----
# INTERFACE
# 3D View
size_of_chain_lines = Slider(0.05, range=0.01..1)
mesh_sphere = MeshSphere(Base=PlaneXY(0, 0, 0), Radius=10, UCount=10, VCount=20)
create_3d_view = Create3DView(
    MeshToDisplay=mesh_sphere,
    MeshColors=RGB(255, 0, 0),
    ViewWidth=Slider(426, range=0..1000),
    ViewHeight=Slider(331, range=0..1000))
merge_3 = Merge()  # -> flatten(Result)

panel_2 = Panel("""0
0
1
1
2
2""")
panel_3 = Panel("""0
1
2
0
1
2
0
1
2
0
1
2""")
create_grid = CreateGrid(
    UIElements=merge_3,
    Width=Slider(5704, range=0..10000),
    Height=Slider(6001, range=0..10000),
    RowDefinitions=[Slider(445, range=0..1000), Slider(436, range=0..1000), Slider(67, range=0..100)],
    ColumnDefinitions=[Slider(443, range=0..1000), Slider(394, range=0..1000), Slider(93, range=0..1000)],
    ElementRow=panel_2,
    ElementColumn=panel_3,
    ElementRowSpan=1,
    ElementColumnSpan=1)
adjust_element_positioning = AdjustElementPositioning(
    ElementsToAdjust=create_grid,
    Margin="10,10,0,0",
    AbsolutePositioning=False,
    Width=Slider(2184, range=0..10000),
    Height=Slider(787, range=0..1000))

# ----
# Use the ANIMATE slider to
# interpolate between states
animate = Slider(0.6, range=0..1)
aa_range = Slider(96, range=0..100)  # disabled
create_slider = CreateSlider(Slider=animate, ShowBounds=False, ShowTicks=False, ShowTooltip=False, ShowValLabel=True, showLabel=True)
create_slider_2 = CreateSlider(Slider=aa_range, ShowBounds=False, ShowTicks=False, ShowTooltip=False, ShowValLabel=True, showLabel=True)  # disabled
value_listener = ValueListener(Elements=create_slider_2, SomeProperty=True)  # -> Values, Indices
value_listener_2 = ValueListener(Elements=create_slider, SomeProperty=True)  # -> Values, Indices
create_slider_3 = CreateSlider(ShowBounds=False, ShowTicks=False, ShowTooltip=False, ShowValLabel=True, showLabel=True)
value_listener_3 = ValueListener(Elements=create_slider_3, SomeProperty=True)  # -> Values, Indices
create_slider_4 = CreateSlider(ShowBounds=False, ShowTicks=False, ShowTooltip=False, ShowValLabel=True, showLabel=True)
aa_range_2 = Domain(Domain(0, 300))
aa_range_3 = Domain(Domain(0, 100))
create_range_slider = CreateRangeSlider(SliderRange=aa_range_2, StartingRange=aa_range_3)  # disabled
panel_4 = Panel("""40:60,
150:180""")
value_listener_4 = ValueListener(Elements=create_range_slider, SomeProperty=True)  # -> Values, Indices; disabled
create_text_box = CreateTextBox(Label="Slices", DefaultText=panel_4, UpdateButton=True, showLabel=True)
value_listener_5 = ValueListener(Elements=create_text_box, SomeProperty=True)  # -> Values, Indices
text_split = TextSplit(Text=value_listener_5.Values, Separators=",")

# ---- group: State Data
# PARSE DATA
# Input State data
# path (csv)
panel_5 = Panel("C:\Users\Flora\OneDrive - The Alan Turing Institute\Turing\1.Projects\3.Protein_folding\1.Data\GlyP_state_data_all_concentrations.csv")
state_reader = StateReader(data_input_path=panel_5)  # -> start_aa_3, end_aa_3, state_3, uptake_3, centre_3, exposure_3
create_set = CreateSet(List=state_reader.state_3)  # -> Set, Map
panel_6 = Panel(create_set.Set)
slice_no = Slider(10, range=0..190)
number_slider = Slider(47, range=0..1000)

# ---- group: State Data / Creates series of AA from start to end AA
subtraction = Subtraction(A=state_reader.end_aa_3, B=state_reader.start_aa_3)
addition = Addition(A=subtraction, B=1)
series = Series(Start=state_reader.start_aa_3, Step=1, Count=addition)

# ---- group: State Data / Seperates list per Exposure
create_set_2 = CreateSet(List=state_reader.exposure_3)  # -> Set, Map
equality = Equality(FirstNumber=graft(create_set_2.Set), SecondNumber=state_reader.exposure_3)  # -> Equality, Inequality

# ----
create_pulldown_menu = CreatePulldownMenu(Label="State", ListItems=create_set.Set, showLabel=True)
merge_4 = Merge(
    Data1=flatten(create_slider),
    Data2=flatten(create_slider_2),
    Data3=flatten(create_text_box),
    Data4=flatten(create_3d_view),
    Data5=flatten(create_pulldown_menu),
    Data6=flatten(create_chart))
create_expander_3 = CreateExpander(UIElements=merge_4, Header="3D VIEW", Open=True)

# ----
# Set the toggle to the right to "True" to launch the window.
number_slider_2 = Slider(800, range=0..1000)
merge_5 = Merge(Data1=flatten(create_expander_3), Data2=flatten(create_expander), Data3=flatten(create_expander_2))
launch_window = LaunchWindow(
    Show=Toggle(False),
    Name="Control Window",
    Width=number_slider_2,
    Height=Slider(600, range=0..1000),
    ChildStatus=0,
    EnableHorizScroll=False)
add_elements = AddElements(Window=launch_window, Elements=flatten(merge_5), DoVLChecking=True)  # -> AddedElements, ElementNames

# ---- group: Parse PDB
# PARSE PDB
# Input Active (End) state
# PDB path
# Input Inactive state
# PDB path
panel_7 = Panel("C:\Users\Flora\OneDrive - The Alan Turing Institute\Turing\1.Projects\3.Protein_folding\1.Data\GlyP_AMP.pdb")
panel_8 = Panel("C:\Users\Flora\OneDrive - The Alan Turing Institute\Turing\1.Projects\3.Protein_folding\1.Data\GlyP_G6P.pdb")
pdb_reader = PDB_Reader(pdb_path=panel_8)  # -> atom_order_3, aa_number_2, aa_name_2, xyz_point, atoms_name_2
pdb_reader_2 = PDB_Reader(pdb_path=panel_7)  # -> atom_order_3, aa_number_2, aa_name_2, xyz_point, atoms_name_2
aa_range_4 = Domain(Domain(0, 300))
filter_aa_properties = GhPythonScript(
    AA=pdb_reader.aa_number_2,
    AA_name=pdb_reader.aa_name_2,
    xyz=pdb_reader.xyz_point,
    atoms=pdb_reader.atoms_name_2,
    mask=aa_range_4)  # -> out, atoms_xyz_list, atoms_name_list, amino_list; inputs AA: list of Int32, AA_name: list, xyz: list, atoms: list
#   port AA: Amino Acid names
# ---------- filter_aa_properties: Python ----------
__author__ = "Flora"
__version__ = "2020.10.28"

"""
This script stores lists of the AA coordinates and properties per AA atom.
eg. [['75.814,-34.543,47.16', '74.639,-34.529,48.079'...],[...]]
    Inputs:
        AA: Amino Acid id number (int list)
        AA_name: Amino Acid name (string list)
        xyz: coordinates in 3Dspace per atom (3d point rhino item)
        atoms: atom names (string list)
    Output:
        a: xyz coordinates for debug
        start: list of coordinates of all atoms per AA (for starting points 
        of lines)
        end: list of coordinates of all atoms per AA (for ending poins of lines)
"""


import rhinoscriptsyntax as rs

counter=-1

amino_list=[]

atom_xyz_list=[]
atoms_xyz_list=[]
atom_name_list=[]
atoms_name_list=[]

temp = []


#TODO: seperate per protein ("TER") 

# store list of atoms per aminoacid
for i in range (len(xyz)):
    if AA[i]!=counter: #a new aminoacid
        if atom_xyz_list != []:
            atoms_xyz_list.append(atom_xyz_list) #store list of atoms per AA
            atoms_name_list.append(atom_name_list)
        counter=AA[i]
        atom_xyz_list=[]
        atom_name_list=[]
        atom_xyz_list.append(xyz[i])
        atom_name_list.append(atoms[i])

        amino_list.append(AA_name[i]) #stores name per chain of AA
    else: # existing aminoacid
        atom_xyz_list.append(xyz[i])
        atom_name_list.append(atoms[i])

atoms_xyz_list.append(atom_xyz_list) #store list of atoms of final AA
atoms_name_list.append(atom_name_list)#store list of atoms names of final AA


if (mask!= None) :

    atoms_xyz_list = atoms_xyz_list[int(mask[0]):int(mask[1])]
    #print (atoms_xyz_list)
    atoms_name_list=atoms_name_list[int(mask[0]):int(mask[1])]
    amino_list=amino_list [int(mask[0]):int(mask[1])]

else: 
    None
# ---------- end filter_aa_properties ----------
filter_aa_properties_2 = GhPythonScript(
    AA=pdb_reader_2.aa_number_2,
    AA_name=pdb_reader_2.aa_name_2,
    xyz=pdb_reader_2.xyz_point,
    atoms=pdb_reader_2.atoms_name_2,
    mask=aa_range_4)  # -> out, atoms_xyz_list, atoms_name_list, amino_list; inputs AA: list of Int32, AA_name: list, xyz: list, atoms: list; same code as filter_aa_properties
domain = Domain(text_split)

# ---- group: Parse PDB / Animation
animate_2 = Slider(0.6, range=0..1)
xyz_tree = GhPythonScript(xyz=filter_aa_properties.atoms_xyz_list)  # -> out, x_list, y_list, z_list; inputs xyz: list
# ---------- xyz_tree: Python ----------
__author__ = "Flora"
__version__ = "2020.10.28"

"""
Provides a scripting component.
    Inputs:
        AA: Amino Acid id number (int list)
        AA_name: Amino Acid name (string list)
        xyz: coordinates in 3Dspace per atom (3d point rhino item)
        atoms: atom names (string list)
    Output:
        a: xyz coordinates for debug
        start: list of coordinates of all atoms per AA (for starting points of lines) 
        end: list of coordinates of all atoms per AA (for ending poins of lines)
"""


import rhinoscriptsyntax as rs


x_list,y_list,z_list=[],[],[]

def create_xyz_list():

    for i in range (len(xyz)):
        x1,y1,z1=[],[],[]
        for j in range (len(xyz[i])):
            if (xyz[i][j]!=None):
                xyz_str= str(xyz[i][j])
                x,y,z= xyz_str.split(",")
                x1.append(x)
                y1.append(y)
                z1.append(z)
            else:
                x1.append("None")
        x_list.append(x1)
        y_list.append(y1)
        z_list.append(z1)

create_xyz_list()
# ---------- end xyz_tree ----------
xyz_tree_2 = GhPythonScript(xyz=filter_aa_properties_2.atoms_xyz_list)  # -> out, x_list, y_list, z_list; inputs xyz: list
# ---------- xyz_tree_2: Python ----------
__author__ = "Flora"
__version__ = "2020.10.28"

"""
This componment gets the x,y,z list and creates seperate x,y,z, lists per AA 
atom.
    Inputs:
        AA: Amino Acid id number (int list)
        AA_name: Amino Acid name (string list)
        xyz: coordinates in 3Dspace per atom (3d point rhino item)
        atoms: atom names (string list)
    Output:
        a: xyz coordinates for debug
        start: list of coordinates of all atoms per AA (for starting points of lines) 
        end: list of coordinates of all atoms per AA (for ending poins of lines)
"""


import rhinoscriptsyntax as rs


x_list,y_list,z_list=[],[],[]

def create_xyz_list():

    for i in range (len(xyz)):
        x1,y1,z1=[],[],[]
        for j in range (len(xyz[i])):
            if (xyz[i][j]!=None):
                xyz_str= str(xyz[i][j])
                x,y,z= xyz_str.split(",")
                x1.append(x)
                y1.append(y)
                z1.append(z)
            else:
                x1.append("Ter")
                y1.append("Ter")
                z1.append("Ter")
        x_list.append(x1)
        y_list.append(y1)
        z_list.append(z1)


create_xyz_list()
# ---------- end xyz_tree_2 ----------
linear_interpolation = GhPythonScript(
    x1=xyz_tree_2.x_list,
    x2=xyz_tree.x_list,
    y1=xyz_tree_2.y_list,
    y2=xyz_tree.y_list,
    z1=xyz_tree_2.z_list,
    z2=xyz_tree.z_list,
    p=value_listener_2.Values)  # -> out, xyz_list; inputs x1: list, x2: list, y1: list, y2: list, z1: list, z2: list
# ---------- linear_interpolation: Python ----------
__author__ = "Flora"
__version__ = "2020.11.12"

import rhinoscriptsyntax as rs

x,y,z=[],[],[]
#x=p*(x2-x1)+x1
for i in range(len(x1)):
    xyz_temp=[]
    for j in range (len(x1[i])):
        if x1[i][j]!= "Ter":
            x1f= float(x1[i][j])
            x2f= float(x2[i][j])
            x_new=p*(x2f-x1f)+x1f

            y1f= float(y1[i][j])
            y2f= float(y2[i][j])
            y_new=p*(y2f-y1f)+y1f
            
            z1f= float(z1[i][j])
            z2f= float(z2[i][j])
            z_new=p*(z2f-z1f)+z1f
            
            xyz_temp.append("%s,%s,%s" %(x_new,y_new,z_new))
        else:
            x.append("Ter")
    x.append(xyz_temp)


#Created By piac
#from https://gist.github.com/piac/ef91ac83cb5ee92a1294
def list_to_tree(input, none_and_holes=True, source=[0]):
    """Transforms nestings of lists or tuples to a Grasshopper DataTree"""
    from Grasshopper import DataTree as Tree
    from Grasshopper.Kernel.Data import GH_Path as Path
    from System import Array
    def proc(input,tree,track):
        path = Path(Array[int](track))
        if len(input) == 0 and none_and_holes: tree.EnsurePath(path); return
        for i,item in enumerate(input):
            if hasattr(item, '__iter__'): #if list or tuple
                track.append(i); proc(item,tree,track); track.pop()
            else:
                if none_and_holes: tree.Insert(item,path,i)
                elif item is not None: tree.Add(item,path)
    if input is not None: t=Tree[object]();proc(input,t,source[:]);return t

xyz_list=x#list_to_tree(x)
# ---------- end linear_interpolation ----------

# ---- group: Parse PDB
aa_range_5 = Slider(27, range=0..100)
sidechains_to_trees = GhPythonScript(
    AA_slider=aa_range_5,
    atoms_xyz_list=linear_interpolation.xyz_list,
    atoms_name_list=filter_aa_properties_2.atoms_name_list,
    amino_list=filter_aa_properties_2.amino_list)  # -> out, AA_name, start, end, atom_names, atom_xyz; inputs AA_slider: Int32, atoms_xyz_list: list, atoms_name_list: list, amino_list: list
# ---------- sidechains_to_trees: Python ----------
__author__ = "Flora"
__version__ = "2020.10.28"

"""
Provides a scripting component.
    Inputs:
        AA: Amino Acid id number (int list)
        AA_name: Amino Acid name (string list)
        xyz: coordinates in 3Dspace per atom (3d point rhino item)
        atoms: atom names (string list)
    Output:
        a: xyz coordinates for debug
        start: list of coordinates of all atoms per AA (for starting points of lines) 
        end: list of coordinates of all atoms per AA (for ending poins of lines)
"""


import rhinoscriptsyntax as rs


sidechains_dict = {
"GLN":{"A": ["C","C","CA","CA","CB","CG","CD","CD"],
    "B":["O","CA","N","CB","CG","CD","NE2","OE1"]},
"GLU":{"A": ["C","C","CA","CA","CB","CG","CD","CD"],
    "B":["O","CA","N","CB","CG","CD","OE2","OE1"]},
"LYS":{"A": ["C","C","CA","CA","CB","CG","CD","CE"],
    "B": ["O","CA","N","CB","CG","CD","CE","NZ"]},
"ARG":{"A":["C","C","CA","CA","CB","CG","CD","NE","CZ","CZ"],
    "B": ["O","CA","N","CB","CG","CD","NE","CZ","NH1","NH2"]},
"ILE":{"A": ["C","C","CA","CA","CB","CB","CG1"],
    "B": ["O","CA","N","CB","CG1","CG2","CD1"]},
"SER":{"A": ["C","C","CA","CA","CB"],
    "B": ["O","CA","N","CB","OG"]},
"VAL":{"A": ["C","C","CA","CA","CB","CB"],
    "B": ["O","CA","N","CB","CG2","CG1"]},
"HIS": {"A": ["C","C","CA","CA","CB","CG","CG","CD2","CE1","ND1"], 
    "B": ["O","CA","N","CB","CG","ND1","CD2","NE2","NE2","CE1"]},
"GLY":{"A":["C","C","CA"],
    "B": ["O","CA","N"]},
"LEU":{"A": ["C","C","CA","CA","CB","CG","CG"],
    "B": ["O","CA","N","CB","CG","CD1","CD2"]},
"ALA":{"A": ["C","C","CA","CA"],
    "B": ["O","CA","N","CB"]},
"ASN":{"A": ["C","C","CA","CA","CB","CG","CG"],
    "B": ["O","CA","N","CB","CG","OD1","ND2"]},
"THR":{"A": ["C","C","CA","CA","CB","CB"],
    "B": ["O","CA","N","CB","CG2","OG1"]},
"PRO":{"A": ["C","C","CA","CA","CB","CG","CD"],
    "B": ["O","CA","N","CB","CG","CD","N"]},
"ASP":{"A":["C","C","CA","CA","CB","CG","CG"],
    "B": ["O","CA","N","CB","CG","OD1","OD2"]},
"TYR":{"A": ["C","C","CA","CA","CB","CG","CG","CD1","CD2","CE1","CE2","CZ"],
    "B": ["O","CA","N","CB","CG","CD1","CD2","CE1","CE2","CZ","CZ","OH"]},
"PHE":{"A": ["C","C","CA","CA","CB","CG","CG","CD1","CD2","CE1","CE2"],
    "B": ["O","CA","N","CB","CG","CD1","CD2","CE1","CE2","CZ","CZ"]},
"TRP":{"A": ["C","C","CA","CA","CB","CG","CG","CD1","CD2","NE1","CD2","CE2","CE3","CZ3","CH2"], 
    "B": ["O","CA","N","CB","CG","CD2","CD1","NE1","CE2","CE2","CE3","CZ2","CZ3","CH2","CZ2"]},
}



amino_start =[]
amino_end=[]

atom_names=[]
atom_xyz=[]
AA_sublist=[]



def construct_sidechains_points():
    None

def construct_sidechains(amino_list,atoms_name_list,atoms_xyz_list):

    for i in range (len(amino_list)): #(AA_slider): 
        amino_acid = sidechains_dict.get(amino_list[i])
        
        if(amino_acid != None): #if the amino acid exists in the pdb exists in the current dictionary
            AA_sublist.append(amino_list[i])
            
            A = amino_acid.get('A') #get the list of the first points of the AA
            B = amino_acid.get('B') #get the list of the second points of the AA
            atom_list = atoms_name_list[i]
            xyz_list = atoms_xyz_list[i]
            

            #fix beggining and end for lines
            start, end= sidechain(amino_acid,A,B,atom_list,xyz_list)
             
            amino_start.append(start)
            amino_end.append(end)
            
            atom_names.append(atom_list)
            atom_xyz.append(xyz_list)

        else: error = "Amino Acid doesnt exist"

def sidechain(amino_acid,A,B,atom_list,xyz_list):
    start, end=[],[]
    for x in range (len(A)):
        for y in range (len(atom_list)):  #atom_list to change with slider
            if (A[x]==atom_list[y]):
                start.append(xyz_list[y])
            if (B[x]==atom_list[y]):
                end.append(xyz_list[y])
    return (start,end)


#Created By piac
#from https://gist.github.com/piac/ef91ac83cb5ee92a1294
def list_to_tree(input, none_and_holes=True, source=[0]):
    """Transforms nestings of lists or tuples to a Grasshopper DataTree"""
    from Grasshopper import DataTree as Tree
    from Grasshopper.Kernel.Data import GH_Path as Path
    from System import Array
    def proc(input,tree,track):
        path = Path(Array[int](track))
        if len(input) == 0 and none_and_holes: tree.EnsurePath(path); return
        for i,item in enumerate(input):
            if hasattr(item, '__iter__'): #if list or tuple
                track.append(i); proc(item,tree,track); track.pop()
            else:
                if none_and_holes: tree.Insert(item,path,i)
                elif item is not None: tree.Add(item,path)
    if input is not None: t=Tree[object]();proc(input,t,source[:]);return t

#print (atoms_xyz_list)
#sidechain(atoms_xyz_list, amino_names, atoms_name_list)
construct_sidechains(amino_list,atoms_name_list,atoms_xyz_list)

atom_names=list_to_tree(atom_names)
atom_xyz=list_to_tree(atom_xyz)
AA_name=list_to_tree(AA_sublist)
start= list_to_tree(amino_start)
end=list_to_tree(amino_end)


#print (atoms_xyz_list)
# ---------- end sidechains_to_trees ----------

# ---- group: State Data / Filter xyz per AA order in data
xyzpoints = Point(sidechains_to_trees.atom_xyz)
treetolist = GhPythonScript(data=xyzpoints)  # -> output; inputs data: tree of Point3d
# ---------- treetolist: Python ----------
__author__ = "Flora"
__version__ = "2021.01.18"

import rhinoscriptsyntax as rs

#Created By piac
#from https://gist.github.com/piac/ef91ac83cb5ee92a1294
def list_to_tree(input, none_and_holes=True, source=[0]):
    """Transforms nestings of lists or tuples to a Grasshopper DataTree"""
    from Grasshopper import DataTree as Tree
    from Grasshopper.Kernel.Data import GH_Path as Path
    from System import Array
    def proc(input,tree,track):
        path = Path(Array[int](track))
        if len(input) == 0 and none_and_holes: tree.EnsurePath(path); return
        for i,item in enumerate(input):
            if hasattr(item, '__iter__'): #if list or tuple
                track.append(i); proc(item,tree,track); track.pop()
            else:
                if none_and_holes: tree.Insert(item,path,i)
                elif item is not None: tree.Add(item,path)
    if input is not None: t=Tree[object]();proc(input,t,source[:]);return t
    
#Created By piac
#from https://gist.github.com/piac/ef91ac83cb5ee92a1294
# written by Giulio Piacentino, giulio@mcneel.com
def tree_to_list(input, retrieve_base = lambda x: x[0]):
    """Returns a list representation of a Grasshopper DataTree"""
    def extend_at(path, index, simple_input, rest_list):
        target = path[index]
        if len(rest_list) <= target: rest_list.extend([None]*(target-len(rest_list)+1))
        if index == path.Length - 1:
            rest_list[target] = list(simple_input)
        else:
            if rest_list[target] is None: rest_list[target] = []
            extend_at(path, index+1, simple_input, rest_list[target])
    all = []
    for i in range(input.BranchCount):
        path = input.Path(i)
        extend_at(path, 0, input.Branch(path), all)
    return retrieve_base(all)

output=[]

output=tree_to_list(data)
# ---------- end treetolist ----------
selectionfromlists = GhPythonScript(Lists=treetolist, selection=series)  # -> output; inputs Lists: list, selection: tree
# ---------- selectionfromlists: Python ----------
__author__ = "Flora"
__version__ = "2021.01.18"

import rhinoscriptsyntax as rs

output=[]

for i in range(selection.BranchCount):
    subOutput=[]
    for ii in selection.Branch(i):
        number=int(ii)
        print(number)
        if number<len(Lists):
            subOutput.append(Lists[number])
    output.append(subOutput)

#Created By piac
#from https://gist.github.com/piac/ef91ac83cb5ee92a1294
def list_to_tree(input, none_and_holes=True, source=[0]):
    """Transforms nestings of lists or tuples to a Grasshopper DataTree"""
    from Grasshopper import DataTree as Tree
    from Grasshopper.Kernel.Data import GH_Path as Path
    from System import Array
    def proc(input,tree,track):
        path = Path(Array[int](track))
        if len(input) == 0 and none_and_holes: tree.EnsurePath(path); return
        for i,item in enumerate(input):
            if hasattr(item, '__iter__'): #if list or tuple
                track.append(i); proc(item,tree,track); track.pop()
            else:
                if none_and_holes: tree.Insert(item,path,i)
                elif item is not None: tree.Add(item,path)
    if input is not None: t=Tree[object]();proc(input,t,source[:]);return t


#output=list_to_tree(output)
# ---------- end selectionfromlists ----------

# ---- group: State Data / Select Exposure
cull_pattern = CullPattern(List=state_reader.centre_3, CullPattern=equality.Equality)
cull_pattern_2 = CullPattern(List=selectionfromlists, CullPattern=equality.Equality)
explode_tree = ExplodeTree(Data=cull_pattern_2)  # -> Branch0, Branch1, Branch2, Branch3, Branch4, Branch5, Branch6, Branch7
explode_tree_2 = ExplodeTree(Data=cull_pattern)  # -> Branch0, Branch1, Branch2, Branch3, Branch4, Branch5, Branch6, Branch7

# ---- group: State Data (continued)
panel_9 = Panel(create_set_2.Set)
panel_10 = Panel(equality.Equality)
panel_11 = Panel(series)
listtotree_2 = GhPythonScript(Lists=explode_tree.Branch0)  # -> output; inputs Lists: list; same code as listtotree
panel_12 = Panel(explode_tree_2.Branch0)
panel_13 = Panel(listtotree_2)
path_mapper = PathMapper(listtotree_2, source="{A;B;C}", target="{A;B}")
bounds = Bounds(Numbers=panel_12)
remap_numbers = RemapNumbers(Value=panel_12, Source=bounds, Target=Domain(0, 1))  # -> Mapped, Clipped
gradient = Gradient(LowerLimit=0, UpperLimit=1, Parameter=remap_numbers.Mapped, stops=[0: RGB(0, 128, 0), 1: RGB(255, 0, 0)])
selecttreesecondbranchonly = GhPythonScript(tree=listtotree_2, selection=slice_no)  # -> tree_output; inputs tree: tree
# ---------- selecttreesecondbranchonly: Python ----------
__author__ = "Flora"
__version__ = "2021.01.18"

import rhinoscriptsyntax as rs

#Created By piac
#from https://gist.github.com/piac/ef91ac83cb5ee92a1294
def list_to_tree(input, none_and_holes=True, source=[0]):
    """Transforms nestings of lists or tuples to a Grasshopper DataTree"""
    from Grasshopper import DataTree as Tree
    from Grasshopper.Kernel.Data import GH_Path as Path
    from System import Array
    def proc(input,tree,track):
        path = Path(Array[int](track))
        if len(input) == 0 and none_and_holes: tree.EnsurePath(path); return
        for i,item in enumerate(input):
            if hasattr(item, '__iter__'): #if list or tuple
                track.append(i); proc(item,tree,track); track.pop()
            else:
                if none_and_holes: tree.Insert(item,path,i)
                elif item is not None: tree.Add(item,path)
    if input is not None: t=Tree[object]();proc(input,t,source[:]);return t

#Created By piac
#from https://gist.github.com/piac/ef91ac83cb5ee92a1294
# written by Giulio Piacentino, giulio@mcneel.com
def tree_to_list(input, retrieve_base = lambda x: x[0]):
    """Returns a list representation of a Grasshopper DataTree"""
    def extend_at(path, index, simple_input, rest_list):
        target = path[index]
        if len(rest_list) <= target: rest_list.extend([None]*(target-len(rest_list)+1))
        if index == path.Length - 1:
            rest_list[target] = list(simple_input)
        else:
            if rest_list[target] is None: rest_list[target] = []
            extend_at(path, index+1, simple_input, rest_list[target])
    all = []
    for i in range(input.BranchCount):
        path = input.Path(i)
        extend_at(path, 0, input.Branch(path), all)
    return retrieve_base(all)

#tree=tree


#path1=[]
#for i in range(tree.BranchCount):
#    
#    path = tree.Path(i)
#    if len(path)>1 and path[1]=
#    
#    #print(path[1,-1])
#    print(path)
#    print(path[2])
#    #extend_at(path, 1, input.Branch(path), path1)


tree_output=[]
for i in range(tree.BranchCount):
    path = tree.Path(i)
    
    #print(str(path[1]) +" "+str(int(selection)))
    
    if str(path[1])==str(int(selection)):
        print(path[1])
        subTree=[]
        print(i)
        for ii in tree.Branch(i):
            subTree.append(ii)

        tree_output.append(subTree)

tree_output=list_to_tree(tree_output)
# ---------- end selecttreesecondbranchonly ----------

# ---- group: State Data / SelectTreeBranch
tree_statistics = TreeStatistics(Tree=listtotree_2)  # -> Paths, Length, Count
list_item = ListItem(List=tree_statistics.Paths, Index=number_slider, Wrap=True)
tree_branch = TreeBranch(Tree=listtotree_2, Path=list_item, MaintainPaths=True)

# ---- group: State Data / slices viz
multiplylist_2 = GhPythonScript(selection=slice_no, tree=selecttreesecondbranchonly, list=gradient)  # -> tree_output, multipliedList; inputs tree: tree, list: list
# ---------- multiplylist_2: Python ----------
__author__ = "Flora"
__version__ = "2021.01.18"

import rhinoscriptsyntax as rs

#Created By piac
#from https://gist.github.com/piac/ef91ac83cb5ee92a1294
def list_to_tree(input, none_and_holes=True, source=[0]):
    """Transforms nestings of lists or tuples to a Grasshopper DataTree"""
    from Grasshopper import DataTree as Tree
    from Grasshopper.Kernel.Data import GH_Path as Path
    from System import Array
    def proc(input,tree,track):
        path = Path(Array[int](track))
        if len(input) == 0 and none_and_holes: tree.EnsurePath(path); return
        for i,item in enumerate(input):
            if hasattr(item, '__iter__'): #if list or tuple
                track.append(i); proc(item,tree,track); track.pop()
            else:
                if none_and_holes: tree.Insert(item,path,i)
                elif item is not None: tree.Add(item,path)
    if input is not None: t=Tree[object]();proc(input,t,source[:]);return t

#Created By piac
#from https://gist.github.com/piac/ef91ac83cb5ee92a1294
# written by Giulio Piacentino, giulio@mcneel.com
def tree_to_list(input, retrieve_base = lambda x: x[0]):
    """Returns a list representation of a Grasshopper DataTree"""
    def extend_at(path, index, simple_input, rest_list):
        target = path[index]
        if len(rest_list) <= target: rest_list.extend([None]*(target-len(rest_list)+1))
        if index == path.Length - 1:
            rest_list[target] = list(simple_input)
        else:
            if rest_list[target] is None: rest_list[target] = []
            extend_at(path, index+1, simple_input, rest_list[target])
    all = []
    for i in range(input.BranchCount):
        path = input.Path(i)
        extend_at(path, 0, input.Branch(path), all)
    return retrieve_base(all)

#tree=tree


#path1=[]
#for i in range(tree.BranchCount):
#    
#    path = tree.Path(i)
#    if len(path)>1 and path[1]=
#    
#    #print(path[1,-1])
#    print(path)
#    print(path[2])
#    #extend_at(path, 1, input.Branch(path), path1)

multipliedList=[]
tree_output=[]
for i in range(tree.BranchCount):
    path = tree.Path(i)
    subList=[]
    subTree=[]
    print(i)
    for ii in tree.Branch(i):
        print(path)
        subList.append(list[int(selection)])
        subTree.append(ii)
    multipliedList.append(subList)
    tree_output.append(subTree)

tree_output=list_to_tree(tree_output)
multipliedList=list_to_tree(multipliedList)
# ---------- end multiplylist_2 ----------
cloud_display = CloudDisplay(Points=multiplylist_2.tree_output, Colours=multiplylist_2.multipliedList, Size=0.8, SpriteType=0)  # disabled

# ---- group: State Data / To develop averages
multiplylist_3 = GhPythonScript(tree=listtotree_2, list=gradient)  # -> tree_output, multipliedList; inputs tree: tree, list: list; disabled
# ---------- multiplylist_3: Python ----------
__author__ = "Flora"
__version__ = "2021.01.18"

import rhinoscriptsyntax as rs

#Created By piac
#from https://gist.github.com/piac/ef91ac83cb5ee92a1294
def list_to_tree(input, none_and_holes=True, source=[0]):
    """Transforms nestings of lists or tuples to a Grasshopper DataTree"""
    from Grasshopper import DataTree as Tree
    from Grasshopper.Kernel.Data import GH_Path as Path
    from System import Array
    def proc(input,tree,track):
        path = Path(Array[int](track))
        if len(input) == 0 and none_and_holes: tree.EnsurePath(path); return
        for i,item in enumerate(input):
            if hasattr(item, '__iter__'): #if list or tuple
                track.append(i); proc(item,tree,track); track.pop()
            else:
                if none_and_holes: tree.Insert(item,path,i)
                elif item is not None: tree.Add(item,path)
    if input is not None: t=Tree[object]();proc(input,t,source[:]);return t

#Created By piac
#from https://gist.github.com/piac/ef91ac83cb5ee92a1294
# written by Giulio Piacentino, giulio@mcneel.com
def tree_to_list(input, retrieve_base = lambda x: x[0]):
    """Returns a list representation of a Grasshopper DataTree"""
    def extend_at(path, index, simple_input, rest_list):
        target = path[index]
        if len(rest_list) <= target: rest_list.extend([None]*(target-len(rest_list)+1))
        if index == path.Length - 1:
            rest_list[target] = list(simple_input)
        else:
            if rest_list[target] is None: rest_list[target] = []
            extend_at(path, index+1, simple_input, rest_list[target])
    all = []
    for i in range(input.BranchCount):
        path = input.Path(i)
        extend_at(path, 0, input.Branch(path), all)
    return retrieve_base(all)

#tree=tree


#path1=[]
#for i in range(tree.BranchCount):
#    
#    path = tree.Path(i)
#    if len(path)>1 and path[1]=
#    
#    #print(path[1,-1])
#    print(path)
#    print(path[2])
#    #extend_at(path, 1, input.Branch(path), path1)

multipliedList=[]
tree_output=[]
for i in range(tree.BranchCount):
    path = tree.Path(i)
    subList=[]
    subTree=[]
    print(i)
    for ii in tree.Branch(i):
        subList.append(list[path[1]])
        subTree.append(ii)
    multipliedList.append(subList)
    tree_output.append(subTree)

tree_output=list_to_tree(tree_output)
multipliedList=list_to_tree(multipliedList)
# ---------- end multiplylist_3 ----------
cloud_display_2 = CloudDisplay(Points=multiplylist_3.tree_output, Colours=multiplylist_3.multipliedList, Size=0.8, SpriteType=0)  # disabled

# ---- group: State Data (continued)
panel_14 = Panel(tree_branch)

# ---- group: Parse PDB (continued)
cluster = Cluster(tree=sidechains_to_trees.atom_xyz, domain=domain)
cluster_2 = Cluster(tree=sidechains_to_trees.end, domain=domain)
sub_list = SubList(List=sidechains_to_trees.AA_name, Domain=domain, Wrap=True)  # -> List, Index
cluster_3 = Cluster(tree=sidechains_to_trees.start, domain=domain)
cluster_4 = Cluster(tree=sidechains_to_trees.atom_names, domain=domain)
sphere = Sphere(Base=cluster, Radius=0.2)

# ---- group: Parse PDB / Backbone
find_aa_index = GhPythonScript(input=cluster_4, search="CA")  # -> output; inputs input: list
# ---------- find_aa_index: Python ----------
__author__ = "Flora"
__version__ = "2020.10.27"

import rhinoscriptsyntax as rs

output=[]

for i in range(len(input)):
    if input[i] == search: #.find(search)!=-1:
        #print (input[i])
        output.append(i)
# ---------- end find_aa_index ----------
find_aa_index_2 = GhPythonScript(input=cluster_4, search="N")  # -> output; inputs input: list; same code as find_aa_index
find_aa_index_3 = GhPythonScript(input=cluster_4, search="C")  # -> output; inputs input: list; same code as find_aa_index
list_item_2 = ListItem(List=cluster, Index=find_aa_index_3, Wrap=True)  # -> flatten(Item)
list_item_3 = ListItem(List=cluster, Index=find_aa_index_2, Wrap=True)  # -> flatten(Item)
list_item_4 = ListItem(List=cluster, Index=find_aa_index, Wrap=True)  # -> flatten(Item)
cloud_display_3 = CloudDisplay(Points=list_item_2, Colours=ColourSwatch(SwatchColor=RGB(21, 247, 0)), Size=0.5, SpriteType=0)  # disabled
cloud_display_4 = CloudDisplay(Points=list_item_3, Colours=ColourSwatch(SwatchColor=RGB(21, 247, 0)), Size=2, SpriteType=0)
cloud_display_5 = CloudDisplay(Points=size_of_main_chain_aa, Colours=ColourSwatch(SwatchColor=RGB(21, 247, 0)), Size=0.8, SpriteType=0)  # disabled

# ---- group: Parse PDB / Sidechains
line = Line(StartPoint=cluster_3, EndPoint=cluster_2)
graft_tree = GraftTree(Tree=sub_list.List, IncludeEmptyLists=True, IncludeNullItems=True)
cloud_display_6 = CloudDisplay(Points=cluster, Colours=RGB(255, 20, 147), Size=0.21, SpriteType=0)
merge_6 = Merge(Data1=graft_tree, Data2=line)

# ---- group: Parse PDB (continued)
curve = Curve(line)
sphere_2 = Sphere(Base=list_item_4, Radius=size_of_main_chain_aa)
sphere_3 = Sphere(Base=list_item_3, Radius=size_of_main_chain_aa)
sphere_4 = Sphere(Base=list_item_2, Radius=size_of_main_chain_aa)

# ----
curve_2 = Curve(curve)
circle_2 = Circle(Plane=curve_2, Radius=size_of_chain_lines)
extrude_along = ExtrudeAlong(Base=circle_2, Curve=curve_2)  # -> flatten(Extrusion)
mesh = Mesh(sphere_2)
mesh_2 = Mesh(sphere_4)
mesh_3 = Mesh(sphere_3)
mesh_join = MeshJoin(Meshes=mesh)
mesh_join_2 = MeshJoin(Meshes=extrude_along)
mesh_join_3 = MeshJoin(Meshes=mesh_3)
mesh_join_4 = MeshJoin(Meshes=mesh_2)
set_3d_view = Set3DView(
    _3DView=create_3d_view,
    MeshToDisplay=[mesh_join, mesh_join_3, mesh_join_4, mesh_join_2],
    MeshColors=[RGB(188, 143, 143), RGB(0, 255, 0), RGB(255, 0, 255), RGB(255, 0, 0), RGB(255, 128, 128)])

set_shapes = SetShapes(
    ShapeToModify=create_shapes,
    ShapeCurves=curve_2,
    StrokeWeights=Slider(0.5, range=0..1),
    StrokeColors=ColourSwatch(SwatchColor=RGB(230, 0, 0)),
    Scale=Slider(11, range=0..1000))

# ==== cluster PDB_Reader
pdb_path = ClusterInput()

# ---- group: PDB Reader / PDB reader
pdb_path_2 = FilePath(pdb_path)
pdb_open = PDBOpen(protein_data_base_file=pdb_path_2, index=0)  # -> protein_data_selected, protein_data_all
file = ReadFile(File=pdb_path_2, PerLineParse=True)
filter_dbd = GhPythonScript(PDB=file)  # -> P, TER
# ---------- filter_dbd: Python ----------
"""Provides a scripting component.
    Inputs:
        x: The x script variable
        y: The y script variable
    Output:
        a: The a P variable"""

__author__ = "Flora"
__version__ = "2020.10.23"

import rhinoscriptsyntax as rs

PDB = PDB.replace("            ",",")
PDB = PDB.replace("           ",",")
PDB = PDB.replace("          ",",")
PDB = PDB.replace("         ",",")
PDB = PDB.replace("        ",",")
PDB = PDB.replace("       ",",")
PDB = PDB.replace("      ",",")
PDB = PDB.replace("     ",",")
PDB = PDB.replace("    ",",")
PDB = PDB.replace("   ",",")
PDB = PDB.replace("  ",",")
PDB = PDB.replace(" ",",")
#PDB = PDB.replace("TER,","")

if PDB.find("TER"):
    P = PDB
# ---------- end filter_dbd ----------
num = Number([-1, -2])
cull_i = CullIndex(List=filter_dbd.P, Indices=num, Wrap=True)
split = TextSplit(Text=cull_i, Separators=",")

# ---- group: PDB Reader / Atoms_XYZ
z = ListItem(List=split, Index="8", Wrap=True)  # -> flatten(Item)
y = ListItem(List=split, Index="7", Wrap=True)  # -> flatten(Item)
x = ListItem(List=split, Index="6", Wrap=True)  # -> flatten(Item)
num_2 = Number(z)
num_3 = Number(y)
num_4 = Number(x)
pt = ConstructPoint(XCoordinate=num_4, YCoordinate=num_3, ZCoordinate=num_2)

# ---- group: PDB Reader / Atoms_name
item = ListItem(List=split, Index="2", Wrap=True)  # -> flatten(Item)

# ---- group: PDB Reader / Atoms_order
atom_order = ListItem(List=split, Index="1", Wrap=True)  # -> flatten(Item)
atom_order_2 = Number(atom_order)

# ---- group: PDB Reader / AA_number
amino_acid = ListItem(List=split, Index="5", Wrap=True)  # -> flatten(Item)
aa_number = Number(amino_acid)

# ----
atoms_name = Text(item)
aa_number_2 = ClusterOutput(aa_number)
atoms_name_2 = ClusterOutput(atoms_name)
atom_order_3 = ClusterOutput(atom_order_2)
xyz_point = ClusterOutput(pt)

# ---- group: PDB Reader / AA_name
item_2 = ListItem(List=split, Index="3", Wrap=True)  # -> flatten(Item)

# ----
aa_name = Text(item_2)

# ---- group: PDB Reader / AA_name (continued)
panel = Panel(aa_name)

# ----
aa_name_2 = ClusterOutput(aa_name)

# ==== cluster StateReader
data_input_path = ClusterInput()
data = ReadFile(DataInputPath=data_input_path, PerLineParse=True)
num = Number(0)
cull_i = CullIndex(List=data, Indices=num, Wrap=True)
split = TextSplit(Text=cull_i, Separators=",")

end_aa = ListItem(List=split, Index="2", Wrap=True)  # -> flatten(Item)
start_aa = ListItem(List=split, Index="1", Wrap=True)  # -> flatten(Item)
start_aa_2 = Number(start_aa)
end_aa_2 = Number(end_aa)

centre = ListItem(List=split, Index="10", Wrap=True)  # -> flatten(Item)
exposure = ListItem(List=split, Index="9", Wrap=True)  # -> flatten(Item)
uptake = ListItem(List=split, Index="12", Wrap=True)  # -> flatten(Item)
uptake_2 = Number(uptake)
centre_2 = Number(centre)
exposure_2 = Number(exposure)

state = ListItem(List=split, Index="8", Wrap=True)  # -> flatten(Item)
state_2 = Text(state)
start_aa_3 = ClusterOutput(start_aa_2)
end_aa_3 = ClusterOutput(end_aa_2)
state_3 = ClusterOutput(state_2)
centre_3 = ClusterOutput(centre_2)
uptake_3 = ClusterOutput(uptake_2)
exposure_3 = ClusterOutput(exposure_2)

# ==== cluster Cluster
tree = ClusterInput()
tree_statistics = TreeStatistics(Tree=tree)  # -> Paths, Length, Count
domain = ClusterInput()
sub_list = SubList(List=tree_statistics.Paths, Domain=domain, Wrap=True)  # -> List, Index
tree_branch = TreeBranch(Tree=tree, Path=sub_list.List, MaintainPaths=True)
branch = ClusterOutput(tree_branch)

# ==== cluster PDBOpen: make the pdb info accessible
protein_data_base_file = ClusterInput()  # Input the path to a local PDB file, the URL of a PDB file online, or the ID or a PDB file in the RCSB database.
index = ClusterInput()  # If the PDB file has multiple proteins listed, you may choose one.

# ---- group: only one item may be passed
data = Data(protein_data_base_file)
item = ListItem(List=data, Index=0, Wrap=True)
path = FilePath(item)

# ---- group: detrmine if the passed info is a URL (2), a local file path (1) or a Protein ID
concat = Concatenate(FragmentA="http://www.rcsb.org/pdb/files/", FragmentB=path, FragmentC=".pdb")

tmatch = MatchText(Text=path, Pattern="*:*", Case=True)

tmatch_2 = MatchText(Text=path, RegEx="http://", Case=True)
addition = Addition(A=tmatch, B=tmatch_2)
filter = StreamFilter(Gate=addition, Stream0=concat, Stream2=path)
url = CSharpScript(url=filter, L=True)  # -> out, C; inputs url: String, L: Boolean
# ---------- url: C# ----------
    //turn caching on and off
    bool cache = true;

    if(url == "") return;

    //everything in here is cached unless a parameter changes or cache is off.
    if(cache == false || (cache == true && (url != pastURL || L != pastAsLines)))
    {
      Print("getting url");

      //cache the parameters
      pastURL = url;
      pastAsLines = L;

      //must have http to work with webclient.
      if( !url.StartsWith("http://"))
      {
        url = "http://" + url;
      }

      //open url and read to string.
      System.Net.WebClient Client = new System.Net.WebClient ();
      Stream strm = Client.OpenRead(url);
      StreamReader sr = new StreamReader(strm);

      //L = read individual lines.
      if(L)
      {
        List<string> dataList = new List<string>();
        string line;

        do
        {
          line = sr.ReadLine();
          dataList.Add(line);
        }
        while (line != null);

        C = dataList;

      } else //just read as a block
      {
        string dataString = "";
        string line;

        do
        {
          line = sr.ReadLine();
          dataString += line;
        }
        while (line != null);

        C = dataString;
      }

      strm.Close();
      sr.Close();

      pastResult = C;

    } else {//used cached result.
      C = pastResult;
    }
# ---------- url: C# additional code ----------
  string pastURL = "";
  bool pastAsLines = false;
  object pastResult = null;
# ---------- end url ----------

xor = GateXor(A=flatten(tmatch), B=flatten(tmatch_2))
filter_2 = StreamFilter(Gate=xor, Stream1=path)
file = ReadFile(File=filter_2, PerLineParse=True)

filter_3 = StreamFilter(Gate=addition, Stream0=url.C, Stream1=file, Stream2=url.C)

# ----
tmatch_3 = MatchText(Text=filter_3, RegEx="TER", Case=True)
mindex = MemberIndex(Set=tmatch_3, Member=True)  # -> Index, Count
shift = ShiftList(List=mindex.Index, Shift=1, Wrap=False)
dom = ConstructDomain(DomainStart=mindex.Index, DomainEnd=shift)
subset = SubList(List=filter_3, Domain=dom, Wrap=True)  # -> List, Index
tmatch_4 = MatchText(Text=subset.List, RegEx="ATOM", Case=True)
cull = CullPattern(List=subset.List, CullPattern=tmatch_4)
prune = PruneTree(Tree=cull, Minimum=100, Maximum=0)
tstat = TreeStatistics(Tree=prune)  # -> Paths, Length, Count
series = Series(Start=0, Step=1, Count=tstat.Count)
replace = ReplacePaths(Data=prune, Search=tstat.Paths, Replace=series)
browse = BranchBrowser(T=simplify(replace), i=index)
protein_data_selected = ClusterOutput(browse)
protein_data_all = ClusterOutput(replace)

# ==== cluster BranchBrowser: allows you to scroll through the branchs of the tree sequentially using an integer instead of a path
T = ClusterInput()
i = ClusterInput()
tstat = TreeStatistics(Tree=T)  # -> Paths, Length, Count
item = ListItem(List=tstat.Paths, Index=i, Wrap=True)
branch = TreeBranch(Tree=T, Path=item, MaintainPaths=True)
B = ClusterOutput(branch)
