# Grasshopper definition pdb_reader.gh (Grasshopper 1.0.7)
# Copyright: Use it.  Mod it.  Share it. Just please give credit and keep this party going.
# Copyright: Use it.  Mod it.  Share it. Just please give credit and kepp this party going.
# plug-ins: Human

# ---- group: PDB reader
path = FilePath("C:\Users\Flora\OneDrive - The Alan Turing Institute\Turing\3.Protein_folding\1.Data\GlyP_AMP_2.pdb")
file = ReadFile(File=path, PerLineParse=True)
remove_spaces = GhPythonScript(input=file)  # -> output
# ---------- remove_spaces: Python ----------
__author__ = "Flora"
__version__ = "2020.10.23"

import rhinoscriptsyntax as rs

input = input.replace("            ",",")
input = input.replace("           ",",")
input = input.replace("          ",",")
input = input.replace("         ",",")
input = input.replace("        ",",")
input = input.replace("       ",",")
input = input.replace("      ",",")
input = input.replace("     ",",")
input = input.replace("    ",",")
input = input.replace("   ",",")
input = input.replace("  ",",")
input = input.replace(" ",",")
output = input
# ---------- end remove_spaces ----------
pdb_open = PDBOpen(protein_data_base_file=path, index=0)  # -> protein_data_selected, protein_data_all
num = Number([-1, -2])
cull_i = CullIndex(List=remove_spaces, Indices=num, Wrap=True)
split = TextSplit(Text=cull_i, Separators=",")

# ---- group: ALBA
pln = Plane(PlaneXY(-0.3286946811, -0.09005441186, 0))
protein_ribbon = ProteinRibbon(
    location=pln,
    path_to_pdb_file=path,
    threshold_count=6,
    threshold_angle_α_vs_β=0.95,
    alpha_helix_color=RGB(24, 0, 242),
    beta_sheet_color=RGB(242, 210, 0),
    loop_color=RGB(110, 138, 107))  # -> flatten(all_atom_points), flatten(amino_acid_residue_points), flatten(curve), ribbon
crv = Curve(protein_ribbon.curve)
cloud = CloudDisplay(Points=protein_ribbon.amino_acid_residue_points, Colours=RGB(255, 20, 147), Size=1, SpriteType=0)
pt = Point(protein_ribbon.all_atom_points)
bnd = Bounds(Numbers=protein_ribbon.all_atom_points)
remap = RemapNumbers(Value=protein_ribbon.all_atom_points, Source=bnd, Target=Domain(0, 1))  # -> Mapped, Clipped
gradient = Gradient(
    LowerLimit=0,
    UpperLimit=1,
    Parameter=remap.Mapped,
    stops=[0: RGB(65, 107, 105), 0: RGB(12, 226, 64), 0: RGB(166, 16, 169), 0.353: RGB(255, 130, 160), 0.719: RGB(220, 0, 40), 1: RGB(0, 255, 0)])

# ---- group: Atoms_XYZ
z = Slider(8, range=0..10)
y = Slider(7, range=0..10)
x = Slider(6, range=0..20)
z_2 = ListItem(List=split, Index=z, Wrap=True)  # -> flatten(Item)
y_2 = ListItem(List=split, Index=y, Wrap=True)  # -> flatten(Item)
x_2 = ListItem(List=split, Index=x, Wrap=True)  # -> flatten(Item)
num_2 = Number(x_2)
num_3 = Number(z_2)
num_4 = Number(y_2)
pt_2 = ConstructPoint(XCoordinate=num_2, YCoordinate=num_4, ZCoordinate=num_3)

# ---- group: Atoms_name
item = ListItem(List=split, Index=Slider(2, range=0..10), Wrap=True)  # -> flatten(Item)
panel = Panel(item)

# ---- group: AA_name
item_2 = ListItem(List=split, Index=Slider(3, range=0..10), Wrap=True)  # -> flatten(Item)
panel_2 = Panel(item_2)

# ---- group: Atoms_order
z_3 = Slider(1, range=0..10)
atom_order = ListItem(List=split, Index=z_3, Wrap=True)  # -> flatten(Item)
num_5 = Number(atom_order)

# ---- group: AA_number
amino_acid = ListItem(List=split, Index=Slider(5, range=0..10), Wrap=True)  # -> flatten(Item)
num_6 = Number(amino_acid)

# ----
bnd_2 = Bounds(Numbers=num_6)

# ---- group: Backbone
find_aa_index = GhPythonScript(input=item, search="ND1")  # -> output; inputs input: list
# ---------- find_aa_index: Python ----------
__author__ = "Flora"
__version__ = "2020.10.27"

import rhinoscriptsyntax as rs

output=[]

for i in range(len(input)):
    if input[i] == search: #.find(search)!=-1:
        print (input[i])
        output.append(i)
# ---------- end find_aa_index ----------
find_aa_index_2 = GhPythonScript(input=item, search="CA")  # -> output; inputs input: list; same code as find_aa_index
find_aa_index_3 = GhPythonScript(input=item, search="N")  # -> output; inputs input: list
# ---------- find_aa_index_3: Python ----------
__author__ = "Flora"
__version__ = "2020.10.27"

import rhinoscriptsyntax as rs

output=[]

for i in range(len(input)):
    if input[i] == search: #.find(search)!=-1:
        #print (input[i])
        output.append(i)
# ---------- end find_aa_index_3 ----------
find_aa_index_4 = GhPythonScript(input=item, search="C")  # -> output; inputs input: list; same code as find_aa_index
item_3 = ListItem(List=pt_2, Index=find_aa_index, Wrap=True)
item_4 = ListItem(List=pt_2, Index=find_aa_index_3, Wrap=True)
item_5 = ListItem(List=pt_2, Index=find_aa_index_2, Wrap=True)
item_6 = ListItem(List=pt_2, Index=find_aa_index_4, Wrap=True)
cloud_2 = CloudDisplay(Points=item_3, Colours=ColourSwatch(SwatchColor=RGB(0, 230, 107)), Size=0.6, SpriteType=0)
cloud_3 = CloudDisplay(Points=item_5, Colours=ColourSwatch(SwatchColor=RGB(0, 255, 64)), Size=0.8, SpriteType=0)
cloud_4 = CloudDisplay(Points=item_6, Colours=ColourSwatch(SwatchColor=RGB(42, 201, 82)), Size=1, SpriteType=0)
cloud_5 = CloudDisplay(Points=item_4, Colours=ColourSwatch(SwatchColor=RGB(21, 247, 0)), Size=1, SpriteType=0)

# ----
python = GhPythonScript(AA=num_6, AA_name=item_2, xyz=pt_2, atoms=item)  # -> out, a, b, start, end; inputs AA: list of Int32, AA_name: list, xyz: list, atoms: list
#   port AA: Amino Acid names
# ---------- python: Python ----------
__author__ = "Flora"
__version__ = "2020.10.28"

"""
Provides a scripting component.
    Inputs:
        AA: Amino Acid id number (int list)
        AA_name: Amino Acid name (string list)
        xyz: coordinates in 3Dspace per atom (3d point rhino item)
        atoms: atom names (string list)
    Output:
        a: xyz coordinates for debug
        start: list of coordinates of all atoms per AA (for starting points of lines) 
        end: list of coordinates of all atoms per AA (for ending poins of lines)
"""


import rhinoscriptsyntax as rs

counter=-1

amino_list=[]

atom_xyz_list=[]
atom_name_list=[]
atoms_name_list=[]
atoms_xyz_list=[]


sidechains_dict = {
"GLN":{"A": ["C","C","CA","CA","CB","CG","CD","CD"],
    "B":["O","CA","N","CB","CG","CD","NE2","OE1"]},
"GLU":{"A": ["C","C","CA","CA","CB","CG","CD","CD"],
    "B":["O","CA","N","CB","CG","CD","OE2","OE1"]},
"LYS":{"A": ["C","C","CA","CA","CB","CG","CD","CE"],
    "B": ["O","CA","N","CB","CG","CD","CE","NZ"]},
"ARG":{"A":["C","C","CA","CA","CB","CG","CD","NE","CZ","CZ"],
    "B": ["O","CA","N","CB","CG","CD","NE","CZ","NH1","NH2"]},
"ILE":{"A": ["C","C","CA","CA","CB","CB","CG1"],
    "B": ["O","CA","N","CB","CG1","CG2","CD1"]},
"SER":{"A": ["C","C","CA","CA","CB"],
    "B": ["O","CA","N","CB","OG"]},
"VAL":{"A": ["C","C","CA","CA","CB","CB"],
    "B": ["O","CA","N","CB","CG2","CG1"]},
"HIS": {"A": ["C","C","CA","CA","CB","CG","CG","CD2","CE1","ND1"], 
    "B": ["O","CA","N","CB","CG","ND1","CD2","NE2","NE2","CE1"]},
"GLY":{"A":["C","C","CA"],
    "B": ["O","CA","N"]},
"LEU":{"A": ["C","C","CA","CA","CB","CG","CG"],
    "B": ["O","CA","N","CB","CG","CD1","CD2"]},
"ALA":{"A": ["C","C","CA","CA"],
    "B": ["O","CA","N","CB"]},
"ASN":{"A": ["C","C","CA","CA","CB","CG","CG"],
    "B": ["O","CA","N","CB","CG","OD1","ND2"]},
"THR":{"A": ["C","C","CA","CA","CB","CB"],
    "B": ["O","CA","N","CB","CG2","OG1"]},
"PRO":{"A": ["C","C","CA","CA","CB","CG","CD"],
    "B": ["O","CA","N","CB","CG","CD","N"]},
"ASP":{"A":["C","C","CA","CA","CB","CG","CG"],
    "B": ["O","CA","N","CB","CG","OD1","OD2"]},
"TYR":{"A": ["C","C","CA","CA","CB","CG","CG","CD1","CD2","CE1","CE2","CZ"],
    "B": ["O","CA","N","CB","CG","CD1","CD2","CE1","CE2","CZ","CZ","OH"]},
"PHE":{"A": ["C","C","CA","CA","CB","CG","CG","CD1","CD2","CE1","CE2"],
    "B": ["O","CA","N","CB","CG","CD1","CD2","CE1","CE2","CZ","CZ"]},
"TRP":{"A": ["C","C","CA","CA","CB","CG","CG","CD1","CD2","NE1","CD2","CE2","CE3","CZ3","CH2"], 
    "B": ["O","CA","N","CB","CG","CD2","CD1","NE1","CE2","CE2","CE3","CZ2","CZ3","CH2","CZ2"]},
}


# store list of atoms per aminoacid
for i in range (len(AA)):
    if AA[i]!=counter: #a new aminoacid
        if atom_xyz_list != []:
            atoms_xyz_list.append(atom_xyz_list) #store list of atoms per AA
            atoms_name_list.append(atom_name_list)
        counter=AA[i]
        atom_xyz_list=[]
        atom_name_list=[]
        atom_xyz_list.append(xyz[i])
        atom_name_list.append(atoms[i])

        amino_list.append(AA_name[i]) #stores name per chain of AA
    else: # existing aminoacid
        atom_xyz_list.append(xyz[i])
        atom_name_list.append(atoms[i])

atoms_xyz_list.append(atom_xyz_list) #store list of atoms of final AA
atoms_name_list.append(atom_name_list)#store list of atoms names of final AA



amino_start =[]
amino_end=[]

def sidechain(amino_acid,A,B,atom_list,xyz_list):
    start, end=[],[]
    for x in range (len(A)):
        for y in range(len(atom_list)):
            if (A[x]==atom_list[y]):
                start.append(xyz_list[y])
            if (B[x]==atom_list[y]):
                end.append(xyz_list[y])
    return (start,end)

def construct_sidechains(amino_list,atoms_name_list,atoms_xyz_list):

    for i in range (len(amino_list)):
        amino_acid = sidechains_dict.get(amino_list[i])
        if(amino_acid != None): #if the amino acid exists in the pdb exists in the current dictionary
            A = amino_acid.get('A') #get the list of the first points of the AA
            B = amino_acid.get('B') #get the list of the second points of the AA
            atom_list = atoms_name_list[i]
            xyz_list = atoms_xyz_list[i]

            start, end= sidechain(amino_acid,A,B,atom_list,xyz_list)

            amino_start.append(start)
            amino_end.append(end)
        else: error = "Amino Acid doesnt exist"



#Created By piac
#from https://gist.github.com/piac/ef91ac83cb5ee92a1294
def list_to_tree(input, none_and_holes=True, source=[0]):
    """Transforms nestings of lists or tuples to a Grasshopper DataTree"""
    from Grasshopper import DataTree as Tree
    from Grasshopper.Kernel.Data import GH_Path as Path
    from System import Array
    def proc(input,tree,track):
        path = Path(Array[int](track))
        if len(input) == 0 and none_and_holes: tree.EnsurePath(path); return
        for i,item in enumerate(input):
            if hasattr(item, '__iter__'): #if list or tuple
                track.append(i); proc(item,tree,track); track.pop()
            else:
                if none_and_holes: tree.Insert(item,path,i)
                elif item is not None: tree.Add(item,path)
    if input is not None: t=Tree[object]();proc(input,t,source[:]);return t

#print (atoms_xyz_list)
#sidechain(atoms_xyz_list, amino_names, atoms_name_list)
construct_sidechains(amino_list,atoms_name_list,atoms_xyz_list)
a= list_to_tree(atoms_xyz_list)
b= amino_list
start= list_to_tree(amino_start)
end=list_to_tree(amino_end)

#a= atoms_xyz_list
#print (atoms_xyz_list)
# ---------- end python ----------
remap_2 = RemapNumbers(Value=num_6, Source=bnd_2, Target=Domain(0, 1))  # -> Mapped, Clipped
gradient_2 = Gradient(
    LowerLimit=0,
    UpperLimit=1,
    Parameter=remap_2.Mapped,
    stops=[0: RGB(65, 107, 105), 0: RGB(93, 179, 243), 0: RGB(89, 93, 181), 0: RGB(2, 143, 70), 0: RGB(229, 205, 60), 0: RGB(12, 226, 64), 0: RGB(166, 16, 169), 0: RGB(147, 105, 114), 0: RGB(79, 200, 187), 0: RGB(35, 238, 36)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])
ln = Line(StartPoint=python.start, EndPoint=python.end)
graft = GraftTree(Tree=python.b, IncludeEmptyLists=True, IncludeNullItems=True)
panel_3 = Panel(ln)
merge = Merge(Data1=graft, Data2=ln)
cloud_6 = CloudDisplay(Points=pt_2, Colours=gradient_2, Size=0.2, SpriteType=0)
number_slider = Slider(2, range=0..10)
ln_2 = Line(StartPoint=item_6, EndPoint=item_5)
ln_3 = Line(StartPoint=item_4, EndPoint=item_5)
swatch = ColourSwatch(SwatchColor=RGB(105, 32, 178))
eval = EvaluateCurve()  # -> Point, Tangent, Angle
previewlw = CustomPreviewLineweights(Geometry=ln_3, Shader=swatch, Thickness=number_slider, Absolute=False)
previewlw_2 = CustomPreviewLineweights(Geometry=ln_2, Shader=swatch, Thickness=number_slider, Absolute=False)
panel_4 = Panel(merge)
cloud_7 = CloudDisplay(Points=pt, Colours=gradient_2, Size=0.5, SpriteType=0)
number_slider_2 = Slider(0, range=0..1)
number_slider_3 = Slider(2, range=0..10)
swatch_2 = ColourSwatch(SwatchColor=RGB(105, 32, 178))

# ---- group: PDB reader
path_2 = FilePath("C:\Users\Flora\OneDrive - The Alan Turing Institute\Turing\3.Protein_folding\1.Data\GlyP_G6P_2.pdb")
file_2 = ReadFile(File=path_2, PerLineParse=True)
remove_spaces_2 = GhPythonScript(input=file_2)  # -> output; same code as remove_spaces
num_7 = Number([-1, -2])
cull_i_2 = CullIndex(List=remove_spaces_2, Indices=num_7, Wrap=True)
split_2 = TextSplit(Text=cull_i_2, Separators=",")
number_slider_4 = Slider(2, range=0..10)
swatch_3 = ColourSwatch(SwatchColor=RGB(105, 32, 178))

# ---- group: PDB reader / Atoms_XYZ
z_4 = Slider(8, range=0..10)
y_3 = Slider(7, range=0..10)
x_3 = Slider(6, range=0..20)
z_5 = ListItem(List=split_2, Index=z_4, Wrap=True)  # -> flatten(Item)
y_4 = ListItem(List=split_2, Index=y_3, Wrap=True)  # -> flatten(Item)
x_4 = ListItem(List=split_2, Index=x_3, Wrap=True)  # -> flatten(Item)
num_8 = Number(x_4)
num_9 = Number(z_5)
num_10 = Number(y_4)
pt_3 = ConstructPoint(XCoordinate=num_8, YCoordinate=num_10, ZCoordinate=num_9)

# ---- group: PDB reader / Atoms_name
item_7 = ListItem(List=split_2, Index=Slider(2, range=0..10), Wrap=True)  # -> flatten(Item)
panel_5 = Panel(item_7)

# ---- group: PDB reader / AA_name
item_8 = ListItem(List=split_2, Index=Slider(3, range=0..10), Wrap=True)  # -> flatten(Item)
panel_6 = Panel(item_8)

# ---- group: PDB reader / Atoms_order
z_6 = Slider(1, range=0..10)
atom_order_2 = ListItem(List=split_2, Index=z_6, Wrap=True)  # -> flatten(Item)
num_11 = Number(atom_order_2)

# ---- group: PDB reader / AA_number
amino_acid_2 = ListItem(List=split_2, Index=Slider(5, range=0..10), Wrap=True)  # -> flatten(Item)
num_12 = Number(amino_acid_2)

# ---- group: PDB reader / Backbone
find_aa_index_5 = GhPythonScript(input=item_7, search="ND1")  # -> output; inputs input: list; same code as find_aa_index
find_aa_index_6 = GhPythonScript(input=item_7, search="CA")  # -> output; inputs input: list; same code as find_aa_index
find_aa_index_7 = GhPythonScript(input=item_7, search="N")  # -> output; inputs input: list; same code as find_aa_index_3
find_aa_index_8 = GhPythonScript(input=item_7, search="C")  # -> output; inputs input: list; same code as find_aa_index
item_9 = ListItem(List=pt_3, Index=find_aa_index_5, Wrap=True)
item_10 = ListItem(List=pt_3, Index=find_aa_index_7, Wrap=True)
item_11 = ListItem(List=pt_3, Index=find_aa_index_6, Wrap=True)
item_12 = ListItem(List=pt_3, Index=find_aa_index_8, Wrap=True)
cloud_8 = CloudDisplay(Points=item_9, Colours=ColourSwatch(SwatchColor=RGB(187, 0, 230)), Size=0.6, SpriteType=0)
cloud_9 = CloudDisplay(Points=item_11, Colours=ColourSwatch(SwatchColor=RGB(255, 0, 179)), Size=0.8, SpriteType=0)
cloud_10 = CloudDisplay(Points=item_12, Colours=ColourSwatch(SwatchColor=RGB(255, 0, 191)), Size=1, SpriteType=0)
cloud_11 = CloudDisplay(Points=item_10, Colours=ColourSwatch(SwatchColor=RGB(202, 0, 247)), Size=1, SpriteType=0)

# ---- group: PDB reader (continued)
bnd_3 = Bounds(Numbers=num_12)
remap_3 = RemapNumbers(Value=num_12, Source=bnd_3, Target=Domain(0, 1))  # -> Mapped, Clipped
python_2 = GhPythonScript(AA=num_12, AA_name=item_8, xyz=pt_3, atoms=item_7)  # -> out, a, b, start, end; inputs AA: list of Int32, AA_name: list, xyz: list, atoms: list; same code as python
gradient_3 = Gradient(
    LowerLimit=0,
    UpperLimit=1,
    Parameter=remap_3.Mapped,
    stops=[0: RGB(65, 107, 105), 0: RGB(93, 179, 243), 0: RGB(89, 93, 181), 0: RGB(2, 143, 70), 0: RGB(229, 205, 60), 0: RGB(12, 226, 64), 0: RGB(166, 16, 169), 0: RGB(147, 105, 114), 0: RGB(79, 200, 187), 0: RGB(35, 238, 36)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])
graft_2 = GraftTree(Tree=python_2.b, IncludeEmptyLists=True, IncludeNullItems=True)
ln_4 = Line(StartPoint=python_2.start, EndPoint=python_2.end)
panel_7 = Panel(ln_4)
merge_2 = Merge(Data1=graft_2, Data2=ln_4)
panel_8 = Panel(merge_2)
cloud_12 = CloudDisplay(Points=pt_3, Colours=gradient_3, Size=0.2, SpriteType=0)
ln_5 = Line(StartPoint=item_12, EndPoint=item_11)
ln_6 = Line(StartPoint=item_10, EndPoint=item_11)
previewlw_3 = CustomPreviewLineweights(Geometry=ln_6, Shader=swatch_3, Thickness=number_slider_4, Absolute=False)
previewlw_4 = CustomPreviewLineweights(Geometry=ln_5, Shader=swatch_3, Thickness=number_slider_4, Absolute=False)

# ----
python_3 = GhPythonScript(x1=num_4, x2=num_10, p=number_slider_2)  # -> out, x
# ---------- python_3: Python ----------
__author__ = "Flora"
__version__ = "2020.11.12"

import rhinoscriptsyntax as rs

x=p*(x2-x1)+x1
# ---------- end python_3 ----------
python_4 = GhPythonScript(x1=num_3, x2=num_9, p=number_slider_2)  # -> out, x; same code as python_3
python_5 = GhPythonScript(x1=num_2, x2=num_8, p=number_slider_2)  # -> out, x; same code as python_3
pt_4 = ConstructPoint(XCoordinate=python_5.x, YCoordinate=python_3.x, ZCoordinate=python_4.x)

# ---- group: Backbone
find_aa_index_9 = GhPythonScript(input=item_7, search="ND1")  # -> output; inputs input: list; same code as find_aa_index
find_aa_index_10 = GhPythonScript(input=item_7, search="CA")  # -> output; inputs input: list; same code as find_aa_index
find_aa_index_11 = GhPythonScript(input=item_7, search="N")  # -> output; inputs input: list; same code as find_aa_index_3
find_aa_index_12 = GhPythonScript(input=item_7, search="C")  # -> output; inputs input: list; same code as find_aa_index
item_13 = ListItem(List=pt_4, Index=find_aa_index_9, Wrap=True)
item_14 = ListItem(List=pt_4, Index=find_aa_index_11, Wrap=True)
item_15 = ListItem(List=pt_4, Index=find_aa_index_10, Wrap=True)
item_16 = ListItem(List=pt_4, Index=find_aa_index_12, Wrap=True)
cloud_13 = CloudDisplay(Points=item_13, Colours=ColourSwatch(SwatchColor=RGB(187, 0, 230)), Size=0.6, SpriteType=0)
cloud_14 = CloudDisplay(Points=item_15, Colours=ColourSwatch(SwatchColor=RGB(255, 247, 0)), Size=0.8, SpriteType=0)
cloud_15 = CloudDisplay(Points=item_16, Colours=ColourSwatch(SwatchColor=RGB(251, 255, 0)), Size=1, SpriteType=0)
cloud_16 = CloudDisplay(Points=item_14, Colours=ColourSwatch(SwatchColor=RGB(231, 247, 0)), Size=1, SpriteType=0)

# ----
bnd_4 = Bounds(Numbers=num_12)
remap_4 = RemapNumbers(Value=num_12, Source=bnd_4, Target=Domain(0, 1))  # -> Mapped, Clipped
python_6 = GhPythonScript(AA=num_12, AA_name=item_8, xyz=pt_4, atoms=item_7)  # -> out, a, b, start, end; inputs AA: list of Int32, AA_name: list, xyz: list, atoms: list; same code as python
gradient_4 = Gradient(
    LowerLimit=0,
    UpperLimit=1,
    Parameter=remap_4.Mapped,
    stops=[0: RGB(65, 107, 105), 0: RGB(93, 179, 243), 0: RGB(89, 93, 181), 0: RGB(2, 143, 70), 0: RGB(229, 205, 60), 0: RGB(12, 226, 64), 0: RGB(166, 16, 169), 0: RGB(147, 105, 114), 0: RGB(79, 200, 187), 0: RGB(35, 238, 36)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])
graft_3 = GraftTree(Tree=python_6.b, IncludeEmptyLists=True, IncludeNullItems=True)
ln_7 = Line(StartPoint=python_6.start, EndPoint=python_6.end)
merge_3 = Merge(Data1=graft_3, Data2=ln_7)
cloud_17 = CloudDisplay(Points=pt_3, Colours=gradient_4, Size=0.2, SpriteType=0)
ln_8 = Line(StartPoint=item_16, EndPoint=item_15)
ln_9 = Line(StartPoint=item_14, EndPoint=item_15)
previewlw_5 = CustomPreviewLineweights(Geometry=ln_9, Shader=swatch_2, Thickness=number_slider_3, Absolute=False)
previewlw_6 = CustomPreviewLineweights(Geometry=ln_8, Shader=swatch_2, Thickness=number_slider_3, Absolute=False)

# ==== cluster PDBOpen: make the pdb info accessible
protein_data_base_file = ClusterInput()  # Input the path to a local PDB file, the URL of a PDB file online, or the ID or a PDB file in the RCSB database.
index = ClusterInput()  # If the PDB file has multiple proteins listed, you may choose one.

# ---- group: only one item may be passed
data = Data(protein_data_base_file)
item = ListItem(List=data, Index=0, Wrap=True)
path = FilePath(item)

# ---- group: detrmine if the passed info is a URL (2), a local file path (1) or a Protein ID
concat = Concatenate(FragmentA="http://www.rcsb.org/pdb/files/", FragmentB=path, FragmentC=".pdb")

tmatch = MatchText(Text=path, Pattern="*:*", Case=True)

tmatch_2 = MatchText(Text=path, RegEx="http://", Case=True)
addition = Addition(A=tmatch, B=tmatch_2)
filter = StreamFilter(Gate=addition, Stream0=concat, Stream2=path)
url = CSharpScript(url=filter, L=True)  # -> out, C; inputs url: String, L: Boolean
# ---------- url: C# ----------
    //turn caching on and off
    bool cache = true;

    if(url == "") return;

    //everything in here is cached unless a parameter changes or cache is off.
    if(cache == false || (cache == true && (url != pastURL || L != pastAsLines)))
    {
      Print("getting url");

      //cache the parameters
      pastURL = url;
      pastAsLines = L;

      //must have http to work with webclient.
      if( !url.StartsWith("http://"))
      {
        url = "http://" + url;
      }

      //open url and read to string.
      System.Net.WebClient Client = new System.Net.WebClient ();
      Stream strm = Client.OpenRead(url);
      StreamReader sr = new StreamReader(strm);

      //L = read individual lines.
      if(L)
      {
        List<string> dataList = new List<string>();
        string line;

        do
        {
          line = sr.ReadLine();
          dataList.Add(line);
        }
        while (line != null);

        C = dataList;

      } else //just read as a block
      {
        string dataString = "";
        string line;

        do
        {
          line = sr.ReadLine();
          dataString += line;
        }
        while (line != null);

        C = dataString;
      }

      strm.Close();
      sr.Close();

      pastResult = C;

    } else {//used cached result.
      C = pastResult;
    }
# ---------- url: C# additional code ----------
  string pastURL = "";
  bool pastAsLines = false;
  object pastResult = null;
# ---------- end url ----------

xor = GateXor(A=flatten(tmatch), B=flatten(tmatch_2))
filter_2 = StreamFilter(Gate=xor, Stream1=path)
file = ReadFile(File=filter_2, PerLineParse=True)

filter_3 = StreamFilter(Gate=addition, Stream0=url.C, Stream1=file, Stream2=url.C)

# ----
tmatch_3 = MatchText(Text=filter_3, RegEx="TER", Case=True)
mindex = MemberIndex(Set=tmatch_3, Member=True)  # -> Index, Count
shift = ShiftList(List=mindex.Index, Shift=1, Wrap=False)
dom = ConstructDomain(DomainStart=mindex.Index, DomainEnd=shift)
subset = SubList(List=filter_3, Domain=dom, Wrap=True)  # -> List, Index
tmatch_4 = MatchText(Text=subset.List, RegEx="ATOM", Case=True)
cull = CullPattern(List=subset.List, CullPattern=tmatch_4)
prune = PruneTree(Tree=cull, Minimum=100, Maximum=0)
tstat = TreeStatistics(Tree=prune)  # -> Paths, Length, Count
series = Series(Start=0, Step=1, Count=tstat.Count)
replace = ReplacePaths(Data=prune, Search=tstat.Paths, Replace=series)
browse = BranchBrowser(T=simplify(replace), i=index)
protein_data_selected = ClusterOutput(browse)
protein_data_all = ClusterOutput(replace)

# ==== cluster ProteinRibbon: visualizes the structure of a protein
location = ClusterInput()
path_to_pdb_file = ClusterInput()
threshold_count = ClusterInput()  # threshold count for # consequtive residues for seconary structure
threshold_angle_α_vs_β = ClusterInput()  # in radians
alpha_helix_color = ClusterInput()
beta_sheet_color = ClusterInput()
loop_color = ClusterInput()
path = FilePath(path_to_pdb_file)

# ---- group: parsing if PDB file
file = ReadFile(File=path, PerLineParse=True)
split = TextSplit(Text=file, Separators="A")
item = ListItem(List=split, Index=-1, Wrap=True)
trim = TextTrim(Text=item, Start=True, End=True)
split_2 = TextSplit(Text=trim, Separators=" ")
pdb = ImportPDB(File=path)  # -> Atoms, Bonds

# ---- group: parsing if PDB data
split_3 = TextSplit(Text=path, Separators="A")
item_2 = ListItem(List=split_3, Index=-1, Wrap=True)
trim_2 = TextTrim(Text=item_2, Start=True, End=True)
split_4 = TextSplit(Text=trim_2, Separators=" ")
num = Number(split_4)
clean = CleanTree(RemoveNulls=True, RemoveInvalid=True, RemoveEmpty=True, Tree=num)
item_3 = ListItem(List=clean, Index=1, Wrap=True)  # -> Item, Item1, Item2
pt = ConstructPoint(XCoordinate=item_3.Item, YCoordinate=item_3.Item1, ZCoordinate=item_3.Item2)  # -> flatten(Point)

# ---- group: is it a PDB file or PDB data?
null = NullItem(Item=file)  # -> NullFlags, InvalidFlags, Description
item_4 = ListItem(List=flatten(null.NullFlags), Index=0, Wrap=True)
filter = StreamFilter(Gate=item_4, Stream0=split_2, Stream1=split_4)
filter_2 = StreamFilter(Gate=item_4, Stream0=pdb.Atoms, Stream1=pt)

# ---- group: reduce all atom points to AA residue points
item_5 = ListItem(List=filter, Index=0, Wrap=True)
int = Integer(item_5)
clean_2 = CleanTree(RemoveNulls=True, RemoveInvalid=True, RemoveEmpty=True, Tree=int)
subtraction = Subtraction(A=clean_2, B=1)
tstat = TreeStatistics(Tree=graft(filter_2))  # -> Paths, Length, Count
path_2 = ConstructPath(Indices=subtraction)  # -> flatten(Branch)
replace = ReplacePaths(Data=graft(filter_2), Search=tstat.Paths, Replace=path_2)
pt_2 = Point(replace)
item_6 = ListItem(List=pt_2, Index=0, Wrap=True)

# ---- group: create a polyline from the AA residue points and analize angles to find helixes
pline = PolyLine(Vertices=flatten(item_6), Closed=False)
disc = Discontinuity(Curve=pline, Level=1)  # -> Points, Parameters
eval = EvaluateCurve(Curve=pline, Parameter=disc.Parameters)  # -> Point, Tangent, Angle
ta = Number(threshold_angle_α_vs_β)
larger = LargerThan(FirstNumber=eval.Angle, SecondNumber=ta)  # -> LargerThan, OrEqualTo

# ---- group: domains of secondary structures
lng = ListLength(List=larger.LargerThan)
shift = ShiftList(List=larger.LargerThan, Shift=1, Wrap=True)
series = Series(Start=0, Step=1, Count=lng)
equals = Equality(FirstNumber=larger.LargerThan, SecondNumber=shift)  # -> Equality, Inequality
int_2 = Integer(series)
subtraction_2 = Subtraction(A=lng, B=1)
dispatch = Dispatch(List=int_2, DispatchPattern=equals.Equality)  # -> ListA, ListB
ins = InsertItems(List=dispatch.ListB, Item=subtraction_2, Indices=-1, Wrap=True)
ins_2 = InsertItems(List=ins, Item=0, Indices=0, Wrap=True)
consec = ConsecutiveDomains(Numbers=ins_2, Additive=False)

# ---- group: break ribbon into secondary structures / determine sizes of secondary structure to distinguish between 1) alpha helixes and beta sheets or 2) loops
dedomain = DeconstructDomain(Domain=consec)  # -> Start, End
subtraction_3 = Subtraction(A=dedomain.End, B=dedomain.Start)
tc = Number(threshold_count)
larger_2 = LargerThan(FirstNumber=subtraction_3, SecondNumber=tc)  # -> LargerThan, OrEqualTo

# ---- group: break ribbon into secondary structures / points divided into secondary structure
subset = SubList(List=flatten(item_6), Domain=consec, Wrap=True)  # -> List, Index

# ----
tweek_orientation = Slider(0, range=0..10)

# ---- group: seperate helixes from sheets / is this the domain of an alpha helix?
dedomain_2 = DeconstructDomain(Domain=consec)  # -> Start, End
dom = ConstructDomain(DomainStart=expr("x+1", dedomain_2.Start), DomainEnd=dedomain_2.End)
subset_2 = SubList(List=flatten(larger.LargerThan), Domain=dom, Wrap=True)  # -> List, Index
item_7 = ListItem(List=subset_2.List, Index=0, Wrap=True)

# ----
pln = Plane(location)

# ---- group: script that hides all outputs
c_script = CSharpScript()  # -> out; inputs Trigger: tree
# ---------- c_script: C# ----------
    // No code needed here.
# ---------- c_script: C# additional code ----------
  /// <summary>
  /// This method will be called once every solution, before any calls to RunScript.
  /// </summary>
  public override void BeforeRunScript()
  {
    if (GrasshopperDocument == null)
      return;
    
    // Get the owner (if any) of this document.
    IGH_DocumentOwner owner = GrasshopperDocument.Owner;
    if (owner == null)
      return;

    // See if the object owning this document is a cluster.
    IGH_Component cluster = owner as IGH_Component;
    if (cluster == null)
      return;

    // Iterate over all outputs.
    foreach (IGH_Param param in cluster.Params.Output)
    {
      IGH_PreviewObject previewParameter = param as IGH_PreviewObject;
      if (previewParameter != null)
        previewParameter.Hidden = true;
    }
  }
# ---------- end c_script ----------

# ---- group: orient the protein with the first helix or sheet aligned to the Z axis, with the midddle AA residue at the origin, and the middle AA residue of the last helix or sheet on the X axis / determine orientation
dispatch_2 = Dispatch(List=subset.List, DispatchPattern=graft(larger_2.LargerThan))  # -> ListA, ListB
clean_3 = CleanTree(RemoveNulls=True, RemoveInvalid=True, RemoveEmpty=True, Tree=dispatch_2.ListA)
browse = BranchBrowser(T=clean_3, i=tweek_orientation)
item_8 = ListItem(List=flatten(browse), Index=-1, Wrap=True)

# ----
lng_2 = ListLength(List=browse)  # -> expr("x/2", Length)

# ---- group: orient the protein with the first helix or sheet aligned to the Z axis, with the midddle AA residue at the origin, and the middle AA residue of the last helix or sheet on the X axis / determine orientation (continued)
item_9 = ListItem(List=flatten(browse), Index=lng_2, Wrap=True)

# ----
vec2pt = Vector2Pt(PointA=item_9, PointB=item_8, Unitize=False)  # -> Vector, Length
pl = PlaneNormal(Origin=item_9, ZAxis=vec2pt.Vector)

# ---- group: orient the protein with the first helix or sheet aligned to the Z axis, with the midddle AA residue at the origin, and the middle AA residue of the last helix or sheet on the X axis / orient AA residues
orient = Orient(Geometry=subset.List, Source=pl, Target=pln)  # -> Geometry, Transform
simplify = SimplifyTree(Tree=orient.Geometry, Front=False)
amino_acid_residue_points = ClusterOutput(simplify)

# ---- group: seperate helixes and sheets from loops
dispatch_3 = Dispatch(List=orient.Geometry, DispatchPattern=graft(larger_2.LargerThan))  # -> ListA, ListB

# ---- group: orient the protein with the first helix or sheet aligned to the Z axis, with the midddle AA residue at the origin, and the middle AA residue of the last helix or sheet on the X axis / orient atoms
orient_2 = Orient(Geometry=pt_2, Source=pl, Target=pln)  # -> simplify(Geometry), Transform
all_atom_points = ClusterOutput(orient_2.Geometry)

# ---- group: seperate helixes from sheets
dispatch_4 = Dispatch(List=dispatch_3.ListA, DispatchPattern=item_7)  # -> ListA, ListB

# ----
beta_sheet_points = Point(dispatch_4.ListB)
alph_helix_points = Point(dispatch_4.ListA)
loop_points = Point(dispatch_3.ListB)

intcrv = Interpolate(Vertices=beta_sheet_points, Degree=3, Periodic=False, KnotStyle=1)  # -> Curve, Length, Domain
intcrv_2 = Interpolate(Vertices=alph_helix_points, Degree=3, Periodic=False, KnotStyle=1)  # -> Curve, Length, Domain
intcrv_3 = Interpolate(Vertices=loop_points, Degree=3, Periodic=False, KnotStyle=1)  # -> Curve, Length, Domain
merge = Merge(Data1=intcrv_2.Curve, Data2=intcrv.Curve, Data3=intcrv_3.Curve)  # -> simplify(Result)
curve = ClusterOutput(merge)

clean_4 = CleanTree(RemoveNulls=True, RemoveInvalid=True, RemoveEmpty=True, Tree=intcrv_3.Curve)  # -> simplify(Tree)

# ---- group: loops
pipe = Pipe(Curve=clean_4, Radius=Slider(0.22, range=0..1), Caps=2)  # -> simplify(Pipe)
L = Shader(loop_color)
preview = CustomPreview(Geometry=pipe, Shader=L)

# ---- group: beta sheets
clean_5 = CleanTree(RemoveNulls=True, RemoveInvalid=True, RemoveEmpty=True, Tree=intcrv.Curve)  # -> simplify(Tree)

curvepoint = PointOnCurve(clean_5, parameter=0.5)
shift_2 = ShiftList(List=flatten(curvepoint), Shift=1, Wrap=True)  # -> graft(List)
vec2pt_2 = Vector2Pt(PointA=curvepoint, PointB=shift_2, Unitize=False)  # -> Vector, Length
pframe = PerpFrame(Curve=clean_5, Parameter=Slider(0, range=0..0.01))
align = AlignPlane(Plane=pframe, Direction=vec2pt_2.Vector)  # -> Plane, Angle

len = Length(Curve=clean_5)
subtraction_4 = Subtraction(A=len, B=Slider(2, range=0..10))

rectangle = Rectangle(Plane=align.Plane, XSize=Domain(-1.25, 1.25), YSize=Domain(-0.25, 0.25), Radius=0.1)  # -> Rectangle, Length
subcrv = SubCurve(BaseCurve=clean_5, Domain=subtraction_4)
swp1 = Sweep1(Rail=subcrv, Sections=rectangle.Rectangle, Miter=1)  # -> simplify(Brep)
edges = BrepEdges(Brep=swp1)  # -> Naked, Interior, NonManifold
item_10 = ListItem(List=edges.Naked, Index=0, Wrap=True)
offset_out = OffsetOut(curve=item_10, distance_or_xylinus_config=Slider(0.4, range=0..1))
end = EndPoints(Curve=clean_5)  # -> Start, End
extr = ExtrudePoint(Base=offset_out, Point=end.End)  # -> simplify(Extrusion)
β = Shader(beta_sheet_color)
cap = CapHoles(Brep=simplify([swp1, extr]))
sunion = SolidUnion(Breps=cap)

preview_2 = CustomPreview(Geometry=sunion, Shader=β)

# ---- group: alpha helices
clean_6 = CleanTree(RemoveNulls=True, RemoveInvalid=True, RemoveEmpty=True, Tree=intcrv_2.Curve)  # -> simplify(Tree)
pframe_2 = PerpFrame(Curve=clean_6, Parameter=0)
rectangle_2 = Rectangle(Plane=pframe_2, XSize=Domain(-0.25, 0.25), YSize=Domain(-1.25, 1.25), Radius=0.2)  # -> Rectangle, Length
α = Shader(alpha_helix_color)

# ----
extrcrv = ExtrudeAlong(Base=rectangle_2.Rectangle, Curve=clean_6)
cap_2 = CapHoles(Brep=extrcrv)  # -> simplify(Brep)

# ---- group: alpha helices (continued)
preview_3 = CustomPreview(Geometry=cap_2, Shader=α)

# ----
entwine = Entwine(Branch00=cap_2, Branch01=sunion, Branch02=pipe, FlattenInputs=True)
geo = Geometry(entwine)
ribbon = ClusterOutput(geo)

# ==== cluster BranchBrowser: allows you to scroll through the branchs of the tree sequentially using an integer instead of a path
T = ClusterInput()
i = ClusterInput()
tstat = TreeStatistics(Tree=T)  # -> Paths, Length, Count
item = ListItem(List=tstat.Paths, Index=i, Wrap=True)
branch = TreeBranch(Tree=T, Path=item, MaintainPaths=True)
B = ClusterOutput(branch)

# ==== cluster OffsetOut: Offset curves outward. Use for interior curves.
curve = ClusterInput()  # Curves to offset outwards.
distance_or_xylinus_config = ClusterInput()  # Distance to offset curve. If a config is input, the offset distance will be 1/2 the extrusion width.

# ---- group: if fed a config use 1/2 extrusion width, otherwise pass data
data = Data(distance_or_xylinus_config)
item = ListItem(List=data, Index=0, Wrap=True)
item_2 = ListItem(List=data, Index="3", Wrap=True)
box = Box(item)
division = Division(A=item_2, B=2)
null = NullItem(Item=box)  # -> NullFlags, InvalidFlags, Description
filter = StreamFilter(Gate=null.NullFlags, Stream0=division, Stream1=data)
distance = Number(filter)

# ---- group: interior
crv = Curve(curve)

# ----
number_slider = Slider(2, range=0..4)

# ---- group: run a test offset and check to see if it is bigger
D = Number(distance)
offset = Offset(Curve=crv, Distance=D, Plane=PlaneXY(0, 0, 0), Corners=number_slider)
trim = TrimTree(Tree=offset, Depth=1)
area = Area(Geometry=trim)  # -> Area, Centroid
area_2 = Area(Geometry=crv)  # -> Area, Centroid
larger = LargerThan(FirstNumber=area.Area, SecondNumber=area_2.Area)  # -> LargerThan, OrEqualTo

# ---- group: use test offset to determine the direction of the final offset
D_2 = Number(distance)
long = LongestList(ListA=larger.LargerThan, ListB=D_2, PaddingMode=2)  # -> ListA, ListB
neg = Negative(Value=long.ListB)
p_n_c = PickNChoose(Pattern=larger.LargerThan, Stream0=neg, Stream1=long.ListB)
offset_2 = Offset(Curve=crv, Distance=p_n_c, Plane=PlaneXY(0, 0, 0), Corners=number_slider)
trim_2 = TrimTree(Tree=offset_2, Depth=1)

# ---- group: double check and just ditch what isn't right
area_3 = Area(Geometry=trim_2)  # -> Area, Centroid
area_4 = Area(Geometry=crv)  # -> Area, Centroid
larger_2 = LargerThan(FirstNumber=area_3.Area, SecondNumber=area_4.Area)  # -> LargerThan, OrEqualTo
dispatch = Dispatch(List=trim_2, DispatchPattern=larger_2.LargerThan)  # -> ListA, ListB
crv_2 = Curve(dispatch.ListB)

# ---- group: double check and just ditch what isn't right / good interior offsets
crv_3 = Curve(dispatch.ListA)

# ----
offset_cruves = ClusterOutput(crv_3)
